# Grasshopper definition Attractor Points Animation.gh (Grasshopper 1.0.7)
# plug-ins: Bifocals

# ----
# Animate # Slider
number_slider = Slider(20, range=-20..20)

# ----
# A simple Animation (Playful)
number_slider_2 = Slider(100, range=0..100)
number_slider_3 = Slider(4, range=0..39)

construct_domain = ConstructDomain(DomainStart=number_slider_2, DomainEnd=1)
construct_point = ConstructPoint(XCoordinate=expr("x*x", number_slider), YCoordinate=expr("x*x", number_slider), ZCoordinate=expr("x*x", number_slider))
range = Range(Domain=construct_domain, Steps=number_slider_3)
point = Point(construct_point)
construct_point_2 = ConstructPoint(XCoordinate=graft(range), YCoordinate=range, ZCoordinate=0)  # -> flatten(Point)
distance = Distance(PointA=construct_point_2, PointB=graft(point))
flip_matrix = FlipMatrix(Data=distance)
list_item = ListItem(List=flip_matrix, Index=0, Wrap=True)  # -> Item, Item1
ma = MassMultiplication(Input=flip_matrix)  # -> flatten(Result), PartialResults
multiplication = Multiplication(A=list_item.Item, B=list_item.Item1)  # -> flatten(Result)
bounds = Bounds(Numbers=ma.Result)
construct_domain_2 = ConstructDomain(DomainStart=0, DomainEnd=Slider(289, range=0..1000))
unit_z = UnitZ(Factor=1)
remap_numbers = RemapNumbers(Value=ma.Result, Source=bounds, Target=construct_domain_2)  # -> Mapped, Clipped
line_sdl = LineSDL(Start=construct_point_2, Direction=unit_z, Length=remap_numbers.Mapped)
end_points = EndPoints(Curve=line_sdl)  # -> Start, End
surface_from_points = SurfaceFromPoints(Points=flatten(end_points.End), UCount=expr("x+1", number_slider_3), Interpolate=False)
