# Grasshopper definition Editing and combining lists2.gh (Grasshopper 1.0.7)
# plug-ins: Bifocals

number_slider = Slider(1, range=0..1)
number_slider_2 = Slider(0, range=0..100)
number_slider_3 = Slider(10, range=0..20)
number_slider_4 = Slider(10, range=5..10)

multiplication = Multiplication(A=number_slider, B=number_slider_4)
construct_domain = ConstructDomain(DomainStart=number_slider, DomainEnd=multiplication)
construct_domain_2 = ConstructDomain(DomainStart=number_slider_2, DomainEnd=number_slider_4)
param_viewer = ParamViewer(construct_domain)
series = Series(Start=number_slider_2, Step=number_slider, Count=expr("x+1", number_slider_4))
range = Range(Domain=construct_domain_2, Steps=number_slider_4)
panel = Panel([construct_domain, construct_domain_2])
param_viewer_2 = ParamViewer(series)
param_viewer_3 = ParamViewer(range)
panel_2 = Panel(series)
panel_3 = Panel(range)
cross_reference = CrossReference(ListA=series, ListB=range, CrossMode=1)  # -> ListA, ListB
panel_4 = Panel(cross_reference.ListA)
param_viewer_4 = ParamViewer(cross_reference.ListA)
rectangle = Rectangle(Plane=PlaneXY(0, 0, 0), XSize=construct_domain, YSize=multiplication, Radius=0)  # -> Rectangle, Length
construct_point = ConstructPoint(XCoordinate=cross_reference.ListA, YCoordinate=cross_reference.ListB, ZCoordinate=0)
sphere = Sphere(Base=construct_point, Radius=Slider(0.408, range=0..1))
panel_5 = Panel(cross_reference.ListB)
param_viewer_5 = ParamViewer(cross_reference.ListB)
surface = Surface(rectangle.Rectangle)
trim_solid = TrimSolid(Shape=surface, Cutters=sphere)
param_viewer_6 = ParamViewer()
panel_6 = Panel(construct_point)
param_viewer_7 = ParamViewer(construct_point)
