# Grasshopper definition Other Trig Functionsv_002.gh (Grasshopper 1.0.7)
# plug-ins: Bifocals

# Single Phase Cos Curve
number_slider = Slider(4, range=0..100)
# Single Phase Sine Curve
number_slider_2 = Slider(4, range=0..100)
# Single Phase Curve  (ship Hull)
number_slider_3 = Slider(128, range=0..128)
pi = Pi(Factor=number_slider)
pi_2 = Pi(Factor=number_slider_2)
dom = ConstructDomain(DomainStart=0, DomainEnd=pi)
dom_2 = ConstructDomain(DomainStart=0, DomainEnd=pi_2)
pi_3 = Pi(Factor=Slider(0, range=0..4))
number_slider_4 = Slider(0.98, range=0..2)
pi_4 = Pi(Factor=Slider(48, range=0..100))
pi_5 = Pi(Factor=Slider(0, range=0..4))
range = Range(Domain=dom, Steps=number_slider_3)
range_2 = Range(Domain=dom_2, Steps=Slider(128, range=0..128))
dom_3 = ConstructDomain(DomainStart=0, DomainEnd=pi_4)
expression = Expression(A=Slider(5, range=0..10), t=range, x=pi_3, w=Slider(1, range=0..2), Expression="A*cos(w*t+x)")
pi_6 = Pi(Factor=Slider(0, range=0..4))
expression_2 = Expression(A=Slider(5, range=0..10), t=range_2, x=pi_5, w=Slider(1, range=0..2), Expression="A*sin(w*t+x)")
range_3 = Range(Domain=dom_3, Steps=Slider(26, range=0..128))
pt = ConstructPoint(XCoordinate=range, YCoordinate=Slider(6, range=0..10), ZCoordinate=expression)
pt_2 = ConstructPoint(XCoordinate=range_2, YCoordinate=Slider(6, range=0..10), ZCoordinate=expression_2)
expression_3 = Expression(A=Slider(0, range=0..30), t=range_3, x=pi_6, w=number_slider_4, Expression="A*tanh(w*t+x)")
expression_4 = Expression(A=Slider(6, range=0..10), t=range_3, x=pi_6, w=number_slider_4, Expression="A*sin(w*t+x)")
intcrv = Interpolate(Vertices=pt, Degree=3, Periodic=False, KnotStyle=1)  # -> Curve, Length, Domain
intcrv_2 = Interpolate(Vertices=pt_2, Degree=3, Periodic=False, KnotStyle=1)  # -> Curve, Length, Domain
pt_3 = ConstructPoint(XCoordinate=range_3, YCoordinate=Slider(100, range=0..100), ZCoordinate=expression_3)
pt_4 = ConstructPoint(XCoordinate=range_3, YCoordinate=0, ZCoordinate=expression_4)
intcrv_3 = Interpolate(Vertices=pt_4, Degree=3, Periodic=False, KnotStyle=1)  # -> Curve, Length, Domain
intcrv_4 = Interpolate(Vertices=pt_3, Degree=3, Periodic=False, KnotStyle=1)  # -> Curve, Length, Domain
loft = Loft(
    Curves=[intcrv_4.Curve, intcrv_3.Curve],
    Options={Adjust=False, Closed=False, LoftEnds=0, LoftSimp=0, LoftType=0, Rebuild=10, Refit=0.01})
Z = UnitZ(Factor=Slider(43, range=0..100))
extr = Extrude(Base=loft, Direction=Z)
