# Grasshopper definition Surfaces.gh (Grasshopper 1.0.7)
# plug-ins: Bifocals

curve = Curve([<curve referenced from the Rhino model> x2])
md_slider = MDSlider(
    SliderMode=0,
    slider_value=Point(0.6165223963, 0.2954585378, 0.5),
    x_domain=Domain(0, 1),
    y_domain=Domain(0, 1),
    z_domain=Domain(0, 1))
loft = Loft(Curves=curve, Options={Adjust=False, Closed=False, LoftEnds=0, LoftSimp=0, LoftType=0, Rebuild=10, Refit=0.01})
vector_xyz = VectorXYZ(XComponent=Slider(0.778, range=0..1), YComponent=Slider(1, range=0..1), ZComponent=0)  # -> Vector, Length
divide_surface = DivideSurface(Surface=loft, UCount=Slider(8, range=0..100), VCount=Slider(18, range=0..100))  # -> Points, Normals, Parameters
evaluate_surface = EvaluateSurface(Surface=reparameterize(loft), Point=md_slider)  # -> Point, Normal, UDirection, VDirection, Frame
point = Point(<point referenced from the Rhino model>)
distance = Distance(PointA=divide_surface.Points, PointB=evaluate_surface.Point)
line_sdl = LineSDL(Start=divide_surface.Points, Direction=vector_xyz.Vector, Length=1)
one_over_x = OneOverX(Value=distance)
number_slider = Slider(0.468, range=0..1)
bounds = Bounds(Numbers=flatten(one_over_x))
construct_domain = ConstructDomain(DomainStart=Slider(0.132, range=0..1), DomainEnd=Slider(0.965, range=0..1))
remap_numbers = RemapNumbers(Value=one_over_x, Source=bounds, Target=construct_domain)  # -> Mapped, Clipped
pipe = Pipe(Curve=line_sdl, Radius=remap_numbers.Mapped, Caps=0)
panel = Panel(bounds)
